# Grasshopper definition agent-based-reef.gh (Grasshopper 1.0.8)
# plug-ins: RhinoCodePluginGH

hexagon_reef = Geometry(<brep referenced from the Rhino model>)
square_reef = Geometry(<extrusion referenced from the Rhino model>)
surface = Surface(<surface referenced from the Rhino model>)
block = Brep(<brep referenced from the Rhino model>)
mesh = Mesh(<mesh referenced from the Rhino model>)
explode = Explode(Curve=surface, Recursive=True)  # -> Segments, Vertices
popgeo = PopulateGeometry(Geometry=mesh, Count=100, Seed=1)
walker_agent = Python3Script(surface=surface, seed=Slider(10, range=0..10), time=Slider(1000, range=0..1000))  # -> out, a; inputs surface: Surface, seed: Int32, time: Int32
# ---------- walker_agent: Python ----------
import rhinoscriptsyntax as rs
import random as r

# Set the random seed for reproducibility
r.seed(seed)

# Define the Walker class
class Walker:

    def __init__(self, surface):
        # Initialize the surface and position of the walker
        self.surface = surface
        u_domain = rs.SurfaceDomain(surface, 0)
        v_domain = rs.SurfaceDomain(surface, 1)
        # Start at the center of the surface
        self.u = (u_domain[0] + u_domain[1]) / 2
        self.v = (v_domain[0] + v_domain[1]) / 2

    def step(self):
        # Randomly adjust the u and v parameters within the surface domain
        u_domain = rs.SurfaceDomain(self.surface, 0)
        v_domain = rs.SurfaceDomain(self.surface, 1)
        
        du = r.uniform(-5, 5)  # Small random step in u
        dv = r.uniform(-5, 5)  # Small random step in v

        # Update the position while ensuring it stays within the surface domain
        self.u = max(min(self.u + du, u_domain[1]), u_domain[0])
        self.v = max(min(self.v + dv, v_domain[1]), v_domain[0])

    @property
    def point(self):
        # Evaluate the surface at the current u and v parameters to get the 3D point
        return rs.EvaluateSurface(self.surface, self.u, self.v)

# Create a walker instance starting on the input surface
w = Walker(surface)

# List to store points
pList = []

# Iterate for the given number of time steps
for t in range(time):
    w.step()  # Update the walker's position
    pList.append(w.point)  # Add the current position to the list

# Output the list of points
a = [rs.AddPoint(p) for p in pList]  # Visualize points in Rhino
# ---------- end walker_agent ----------
random = Random(Range=Domain(0, 1), Number=1, Seed=popgeo)  # -> flatten(Random)
corners = Point(explode.Vertices)
pt = Point(walker_agent.a)
sph = Sphere(Base=popgeo, Radius=random)
scale = Scale(Geometry=popgeo, Center=Point(0, 0, 0), Factor=Slider(0.95, range=0..1))  # -> Geometry, Transform
sdiff = SolidDifference(BrepsA=square_reef, BrepsB=sph)
point_gradual_translation = Python3Script(points=pt, start_z=Slider(1, range=0..10), end_z=Slider(6.16, range=0..10))  # -> out, a; inputs points: list of Point3d, start_z: Double, end_z: Double
# ---------- point_gradual_translation: Python ----------
import rhinoscriptsyntax as rs

def move_points_z(points, start_z, end_z):
    """
    Moves a list of points down in the Z-axis proportionally between two given distances.
    The first point gets the largest Z translation, the last one gets the smallest.
    """
    # Ensure points are coerced to valid 3D points
    valid_points = []
    
    for pt in points:
        coerced_pt = rs.coerce3dpoint(pt)  # Coerce each point into a valid 3D point
        if coerced_pt:  # If the point is valid
            valid_points.append(coerced_pt)
        else:
            print(f"Invalid point: {pt}")  # Debug: Invalid point

    # Ensure we have at least two valid points
    if len(valid_points) < 2:
        raise ValueError("Input must contain at least two valid points.")
    
    # Calculate the proportional movement for each point
    num_points = len(valid_points)
    distances = [
        start_z + (end_z - start_z) * (i / (num_points - 1))  # Proportional Z movement
        for i in range(num_points)
    ]
    
    # Now move the points
    moved_points = []
    for pt, dist in zip(valid_points, distances):
        moved_point = rs.PointAdd(pt, (0, 0, -dist))  # Move down by dist
        moved_points.append(moved_point)
    
    return moved_points

# Grasshopper Inputs: points, start_z, end_z
if isinstance(points, list):  # Check if points is already a list
    try:
        print("Input points:", points)
        print("Start Z:", start_z, "End Z:", end_z)
        
        # Process the points
        output = move_points_z(points, start_z, end_z)
        
        # Return the moved points
        a = output  # Output the moved points to Grasshopper
    except ValueError as e:
        print(f"Error: {e}")
        a = []  # Return an empty list if error occurs
else:
    print("Error: Points input is not a list.")
    a = []  # Return an empty list if the points are not a list
# ---------- end point_gradual_translation ----------
brep = Brep(<brep referenced from the Rhino model>)
pt_2 = Point(point_gradual_translation.a)
porosity_generator = Python3Script(input_geometry=brep, input_points=scale.Geometry)  # -> out, modified_mesh
# ---------- porosity_generator: Python ----------
# requirements: numpy, scipy
import Rhino.Geometry as rg
import rhinoscriptsyntax as rs
import random

# Define the Agent class
class PorosityAgent:
    def __init__(self, position, radius):
        """
        Initializes the agent.

        Parameters:
        - position: A Rhino.Geometry.Point3d representing the agent's position.
        - radius: The radius of the spherical void created by the agent.
        """
        self.position = position
        self.radius = radius

    def create_void(self):
        """
        Creates a spherical void at the agent's position.

        Returns:
        - A Rhino.Geometry.Sphere.
        """
        return rg.Sphere(self.position, self.radius)

# Function to apply porosity to the geometry
def apply_porosity(input_geometry, points):
    """
    Applies porosity to the given geometry by subtracting spherical voids.

    Parameters:
    - input_geometry: The base Rhino.Geometry.Brep.
    - points: A list of Rhino.Geometry.Point3d defining the void locations.

    Returns:
    - A new Rhino.Geometry.Brep with porosity applied.
    """
    if not isinstance(input_geometry, rg.Brep):
        raise ValueError("Input geometry must be a Brep.")

    # Create a copy of the input geometry to modify
    modified_geometry = input_geometry.DuplicateBrep()

    # Create a list to hold the spherical voids
    voids = []

    # Create agents for each point and generate voids
    for point in points:
        radius = random.uniform(1, 5)  # Random radius between 1 and 5
        agent = PorosityAgent(point, radius)
        voids.append(agent.create_void())

    # Convert spheres to Breps and subtract them from the geometry
    void_breps = [sphere.ToBrep() for sphere in voids]
    for void_brep in void_breps:
        boolean_result = rg.Brep.CreateBooleanDifference([modified_geometry], [void_brep], 0.01)
        if boolean_result:
            modified_geometry = boolean_result[0]

    return modified_geometry

# Grasshopper inputs
# input_geometry: The base geometry (Brep) from Grasshopper
# input_points: A list of points (Point3d) from Grasshopper
if 'input_geometry' in globals() and 'input_points' in globals():
    try:
        # Run the porosity function
        output_geometry = apply_porosity(input_geometry, input_points)
    except Exception as e:
        output_geometry = None
        print(f"Error: {e}")
else:
    output_geometry = None
    print("Error: Ensure 'input_geometry' and 'input_points' are connected in Grasshopper.")
# ---------- end porosity_generator ----------
mesh_generator = Python3Script(input_brep=brep)  # -> out, a
# ---------- mesh_generator: Python ----------
import Rhino.Geometry as rg

def brep_to_mesh(input_brep):
    """
    Convert a Brep (solid or surface) into a Mesh.
    
    Parameters:
    - input_brep: A Rhino Brep object to be converted into a Mesh.
    
    Returns:
    - A Rhino Mesh object created from the input Brep.
    """
    # Ensure the input is a valid Brep
    if not isinstance(input_brep, rg.Brep):
        raise ValueError("Input geometry must be a Brep.")
    
    # Convert Brep to Mesh
    mesh_list = rg.Mesh.CreateFromBrep(input_brep)
    
    # If mesh creation was successful, return the first mesh (in case of multiple)
    if mesh_list and len(mesh_list) > 0:
        return mesh_list[0]
    else:
        raise ValueError("Mesh creation from Brep failed.")
# ---------- end mesh_generator ----------
srfgrid = SurfaceFromPoints(Points=pt_2, UCount=Slider(5, range=0..10), Interpolate=False)
mesh_2 = Mesh(mesh_generator.a)
mesh_3 = Mesh(porosity_generator.modified_mesh)
